# Grasshopper definition 3rob_cell_visualize.ghx (Grasshopper 1.0.7)

# ----
# ROBOT CONNECT
panel = Panel("ros-79hh-s4fg.yaler.io")
ros = ROSConnect(connect=Toggle(True))  # -> ros_client, is_connected; inputs port: Int32, connect: Boolean
#   port ip: The ip address ROS. Defaults to 127.0.0.1.
#   port port: The port of ROS. Defaults to 9090.
#   port connect: If True, connects to ROS. If False, disconnects from ROS. Defaults to False.
#   port ros_client: The ROS client.
#   port is_connected: True if connection established.
# ---------- ros: Python ----------
"""
Connect or disconnect to ROS.

COMPAS FAB v0.19.1
"""
from ghpythonlib.componentbase import executingcomponent as component
from scriptcontext import sticky as st

from compas_fab.backends import RosClient
from compas_fab.ghpython.components import create_id


class ROSConnect(component):
    def RunScript(self, ip, port, connect):
        ros_client = None

        ip = ip or '127.0.0.1'
        port = port or 9090

        key = create_id(self, 'ros_client')
        ros_client = st.get(key, None)

        if ros_client:
            st[key].close()
        if connect:
            st[key] = RosClient(ip, port)
            st[key].run(5)

        ros_client = st.get(key, None)
        is_connected = ros_client.is_connected if ros_client else False
        return (ros_client, is_connected)
# ---------- end ros ----------
data = Data(ros.ros_client)
robot = ROSRobot(ros_client=data, load=Toggle(True))  # -> robot; inputs load: Boolean
#   port ros_client: The ROS client.
#   port load: If True, loads the robot from ROS. Defaults to False.
# ---------- robot: Python ----------
"""
Load robot directly from ROS.

COMPAS FAB v0.19.1
"""
from compas_ghpython.artists import RobotModelArtist
from ghpythonlib.componentbase import executingcomponent as component
from scriptcontext import sticky as st

from compas_fab.ghpython.components import create_id


class ROSRobot(component):
    def RunScript(self, ros_client, load):
        key = create_id(self, 'robot')

        if ros_client and ros_client.is_connected and load:
            # Load URDF from ROS
            st[key] = ros_client.load_robot(load_geometry=True, precision='12f')
            st[key].artist = RobotModelArtist(st[key].model)

        robot = st.get(key, None)
        if robot:  # client sometimes need to be restarted, without needing to reload geometry
            robot.client = ros_client
        return robot
# ---------- end robot ----------
data_2 = Data(robot)

# ----
# ECL PLATFORM MESH
mesh = Mesh([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])

list = ValueList({"tool_gripper": "ecl_pneumatic_gripper", "tool_calibration": "ecl_rob2_calibration_tip"}, selected="tool_calibration")
list_2 = ValueList({"tool_gripper": "ecl_pneumatic_gripper", "tool_calibration": "ecl_rob1_calibration_tip"}, selected="tool_calibration")
list_3 = ValueList({"tool_gripper": "ecl_pneumatic_gripper", "tool_calibration": "ecl_rob3_calibration_tip"}, selected="tool_calibration")

# ----
# Robot 1
j1 = Slider(-0.87, range=-180..180)
j2 = Slider(13.23, range=-90..150)
j3 = Slider(21.78, range=-180..75)
j4 = Slider(-142.41, range=-400..400)
j5 = Slider(60.94, range=-125..120)
j6 = Slider(317.13, range=-400..400)
track = Slider(0, range=0..4)
data_3 = Data([j1, j2, j3, j4, j5, j6, track])

# ----
# Robot 2
j1_2 = Slider(14.71, range=-180..180)
j2_2 = Slider(2.01, range=-90..150)
j3_2 = Slider(22.11, range=-180..75)
j4_2 = Slider(-40.45, range=-400..400)
j5_2 = Slider(10.59, range=-125..120)
j6_2 = Slider(328.15, range=-400..400)
track_2 = Slider(3.9, range=0..4)
data_4 = Data([j1_2, j2_2, j3_2, j4_2, j5_2, j6_2, track_2])

# ----
# Robot 3
j1_3 = Slider(1.16, range=-180..180)
j2_3 = Slider(-7.09, range=-90..150)
j3_3 = Slider(-2.8, range=-180..75)
j4_3 = Slider(-284.75, range=-400..400)
j5_3 = Slider(22.84, range=-125..120)
j6_3 = Slider(-20.34, range=-400..400)
data_5 = Data([j1_3, j2_3, j3_3, j4_3, j5_3, j6_3])

# ----
# Planning Preset
python = GhPythonScript()  # -> config
# ---------- python: Python ----------
#axis 1-6
config = [
40.55,
16.21,
-13.89,
-0.0,
87.68,
130.55]
# ---------- end python ----------
# PRESET CONFIGS
python_2 = GhPythonScript()  # -> config
# ---------- python_2: Python ----------
#ROBOT 1 CONFIG
#Start path planning from

#axis 1-6 + track (mm)
config = [
-37.57,
-3.24,
8.36,
0.19,
84.45,
230,
100]

#config = [
#-37.57,
#-3.24,
#8.36,
#0.19,
#84.45,
#230,
#100]
# ---------- end python_2 ----------
python_3 = GhPythonScript()  # -> config
# ---------- python_3: Python ----------
#ROBOT 1 CONFIG
#Start path planning from

#axis 1-6 + track
config = [
40.55,
16.21,
-13.89,
-0.0,
87.68,
130.55,
3900]

#axis 1-6 + track
#config = [40.55,16.21,-13.89,-0.0,87.68,130.55,3900]
# ---------- end python_3 ----------
config = GhPythonScript(robot=data_2, r1=python_2, r2=python_3, r3=python)  # -> config, config_scaled; inputs r1: list, r2: list, r3: list
# ---------- config: Python ----------
import math

config = robot.zero_configuration()

for i in range(6):
    config['r1_joint_{}'.format(i + 1)] = r1[i]
    config['r2_joint_{}'.format(i + 1)] = r2[i]
    config['r3_joint_{}'.format(i + 1)] = r3[i]

#mm
config['r1_cart_joint'] = r1[6]
config['r2_cart_joint'] = r2[6]

print config

#for use in path planning
#radians and meters
config_scaled = robot.zero_configuration()

for i in range(6):
    config_scaled['r1_joint_{}'.format(i + 1)] = math.radians(r1[i])
    config_scaled['r2_joint_{}'.format(i + 1)] = math.radians(r2[i])
    config_scaled['r3_joint_{}'.format(i + 1)] = math.radians(r3[i])

#mm --> m
config_scaled['r1_cart_joint'] = r1[6]/1000
config_scaled['r2_cart_joint'] = r2[6]/1000

print config_scaled
# ---------- end config ----------

# ----
# Return Preset
python_4 = GhPythonScript()  # -> config
# ---------- python_4: Python ----------
#RETURN CONFIG (BEFORE PICKUP)

#axis 1-6 + track (mm)
config = [
-90.0,
0.0,
0.0,
0.0,
90,
180,
100]
# ---------- end python_4 ----------
python_5 = GhPythonScript()  # -> config
# ---------- python_5: Python ----------
#RETURN CONFIG (BEFORE PICKUP)

#axis 1-6 + track
config = [
90.0,
0.0,
0.0,
0.0,
90,
180,
3900]
# ---------- end python_5 ----------
# READ IN 3 POINT WOBJ CONFIGS
python_6 = GhPythonScript()  # -> config
# ---------- python_6: Python ----------
#axis 1-6
config = [
90.0,
0.0,
0.0,
0.0,
90,
180]
# ---------- end python_6 ----------
config_2 = GhPythonScript(robot=data_2, r1=python_4, r2=python_5, r3=python_6)  # -> config, config_scaled; inputs r1: list, r2: list, r3: list; same code as config

python_7 = GhPythonScript()  # -> wobj_transform, test_point, draw_frame, draw_point
# ---------- python_7: Python ----------
from compas.geometry import Frame
from compas.geometry import Point
from compas.geometry import Vector

from compas_ghpython.artists import FrameArtist
from compas_ghpython.artists import PointArtist
from compas.geometry import Translation

#THESE ARE WOBJS FOR R1 AND R3 TO TRANSFORM

#wobj1 = Frame(Point(0.8, 1.3, 0), Vector(1, 0, 0), Vector(0, 1, 0))

#R1
#p=[3.10333,1.48111,0.36683]
#wobj_transform = Frame.from_quaternion([0.999976,-0.00604606,-0.00149283,-0.0029774],p)

#R3
p = [1.77627,0.240085,0.695195]
wobj_transform = Frame.from_quaternion([0.00447221,-0.000156608,-0.00949994,0.999945], p)

#p = Point(1.8, 0, 0.5)
#wobj_transform = Frame(p, Vector(-0.5, 0 , 0.5), Vector(0, 1, 0))

print wobj_transform
print wobj_transform.xaxis

t = Translation.from_vector(wobj_transform.xaxis)
test_point = Point.from_data(p).transformed(t)
#test_point = Point.from_data(p) + [2,0,0]

print test_point

artist = FrameArtist(wobj_transform)
draw_frame = artist.draw()

artist = PointArtist(test_point)
draw_point = artist.draw()
# ---------- end python_7 ----------
pt = Point(python_7.draw_frame)
pt_2 = Point(python_7.draw_point)
pln = Plane(python_7.draw_frame)

python_8 = GhPythonScript()  # -> wobj_true, test_point, draw_frame, draw_point
# ---------- python_8: Python ----------
from compas.geometry import Frame
from compas.geometry import Point
from compas.geometry import Vector

from compas_ghpython.artists import FrameArtist
from compas_ghpython.artists import PointArtist
from compas.geometry import Translation

#ASSUMING R2 IS GROUND TRUTH, TRANSFORM REST TO MATCH
#wobj2 = Frame(Point(1, 1, 0), Vector(1, 0, 0), Vector(0, 1, 0))

p = [3.10765,1.47891,0.367994]
wobj_true = Frame.from_quaternion([0.99999,-0.00305874,-0.00165978,-0.0029736], p)

#p = Point(3,0,0.5)
#wobj_true = Frame(p, Vector(1, 0, 0), Vector(0, 1, 0))

print wobj_true.xaxis

t = Translation.from_vector(wobj_true.xaxis)
test_point = Point.from_data(p).transformed(t)
#test_point = Point.from_data(p)
#test_point = Point.from_data(p) + [1,0,0]

print test_point

artist = FrameArtist(wobj_true)
draw_frame = artist.draw()

artist = PointArtist(test_point)
draw_point = artist.draw()
# ---------- end python_8 ----------
pt_3 = Point(python_8.draw_frame)
pln_2 = Plane(python_8.draw_frame)
pt_4 = Point(python_8.draw_point)

list_4 = ValueList({"Robot 1": 1, "Robot 2": 2, "Robot 3": 3}, selected="Robot 1")
python_9 = GhPythonScript(wobj1=python_7.wobj_transform, p1=python_7.test_point, wobj2=python_8.wobj_true, p2=python_8.test_point)  # -> out, wobj1_new_out, p2_out, p2_new_out
# ---------- python_9: Python ----------
from compas.geometry import Transformation
from compas_ghpython.artists import FrameArtist
from compas_ghpython.artists import PointArtist

from compas.geometry import Frame
from compas.geometry import Point
from compas.geometry import Vector
from compas.geometry import Transformation
from compas.geometry import Translation
from compas.geometry import translate_points

import copy

################

print "wobj to transform: ", wobj1


# location of wobj to transform
x,y,z = wobj1.point
print "\n", x, y, z

#Scaling vectors (in dirn of wobj to transform)
vec_x = -wobj1.xaxis.unitized().scaled(x)
vec_y = -wobj1.yaxis.unitized().scaled(y)
vec_z = -wobj1.zaxis.unitized().scaled(z)
print "\n", vec_x, vec_y, vec_z

#New wobj transformed from the location of the correct wobj
p_wobj_new = copy.deepcopy(wobj2.point)

p_wobj_new.transform(Translation.from_vector(vec_x))
p_wobj_new.transform(Translation.from_vector(vec_y))
p_wobj_new.transform(Translation.from_vector(vec_z))
print "\n", p_wobj_new

wobj1_new = copy.deepcopy(wobj1)
wobj1_new.point = p_wobj_new
print "\n NEW WOBJ: ", wobj1_new


#wobj1_new = copy.deepcopy(wobj1)
#p = Point(4.626, 0, -0.419) #2m, 45 degree rotated
#p = Point(4.8, 0, 1) #1m, 0 degree rotated
#wobj1_new.point = p

p2_in_wobj1_new = wobj1_new.to_local_coordinates(p2)
print "\nPoint in World to Send; ", p2_in_wobj1_new 


############

artist = FrameArtist(wobj1_new)
wobj1_new_out = artist.draw()



################

artist = PointArtist(p2)
p2_out = artist.draw()

artist = PointArtist(p2_in_wobj1_new)
p2_new_out = artist.draw()
# ---------- end python_9 ----------
pt_5 = Point(python_9.p2_out)
pt_6 = Point(python_9.p2_new_out)
pt_7 = Point(python_9.wobj1_new_out)
pln_3 = Plane(python_9.wobj1_new_out)
# R1
data_6 = Data(["1.41352194014 -0.755614585017 5.42870911028", "1.41441734045 -0.71272421221 4.99942051718", "1.38773831787 -0.715457244436 4.83998529123"])
# R2
data_7 = Data(["0.000196763021876 -1.37113384988 -0.369203721385", "-0.00337207734047 -1.37055267719 -0.362248828444", "-0.00152633363815 -1.37017873609 -0.362394799112"])
# R3
data_8 = Data(["414.400395477 6.48682062458 79.0490852669", "415.102143816 5.38551858721 77.7981135851", "415.541990192 5.34842253598 75.3489055142"])
# These are the differences between the tcf frame point between the FK based on the specified URDF and ACTUAL values from the controller. The same joint configs are used in both cases, but there are differences in the TCF frame location.
# 
# Shift the URDF base of each robot by the opposite of these values to bring the errors closer to zero.
# 
#  For example, if the z-value of the tcf calculated based on the URDF is 5mm larger than the z-value of the tcf from the ACTUAL, then shift the URDF base of the robot down by 5mm
panel_2 = Panel(data_6)
panel_3 = Panel(data_7)
panel_4 = Panel(data_8)
data_9 = Data(["0.000196763021876 -0.00113384988421 -0.00920372138496", "-0.00337207734047 -0.000552677189125 -0.00224882844374", "-0.00152633363815 -0.000178736086376 -0.00239479911257"])
data_10 = Data(["0.0135219401423 -0.0556145850175 0.428709110278", "0.0144173404495 -0.0127242122099 -0.000579482817231", "-0.0122616821261 -0.0154572444357 -0.160014708766"])
data_11 = Data(["-0.599604523234 0.786820624579 1.64908526688", "0.102143816414 -0.314481412785 0.398113585129", "0.541990192464 -0.351577464024 -2.05109448576"])
# difference between TCF_URDF and TCF_ACTUAL after correction to the URDF robot base values
panel_5 = Panel(data_10)
panel_6 = Panel(data_9)
panel_7 = Panel(data_11)

# ----
# ROBOT2
panel_8 = Panel("3246.00")
panel_9 = Panel("1836.50")
panel_10 = Panel("733.40")
pt_8 = ConstructPoint(XCoordinate="2766.30", YCoordinate="1481.89", ZCoordinate="366.79")
Z = UnitZ(Factor="450.00")
division = Division(A=pt_8, B=1000)
division_2 = Division(A=Z, B=1000)
pl = ConstructPlane(Origin=division, XAxis=Vector(-1, 0, 0), YAxis=Vector(0, 1, 0))
pl_2 = ConstructPlane(Origin=pt_8, XAxis=Vector(-1, 0, 0), YAxis=Vector(0, 1, 0))
move = Move(Geometry=pl, Motion=division_2)  # -> Geometry, Transform
move_2 = Move(Geometry=pl_2, Motion=Z)  # -> Geometry, Transform
pln_4 = Plane(move.Geometry)
pln_5 = Plane(move_2.Geometry)
pln_6 = Plane(pl_2)
pln_7 = Plane(pl)

merge = Merge(Data1=pln_4, Data2=pln_7)
python_10 = GhPythonScript()  # -> out, T
# ---------- python_10: Python ----------
from compas.geometry import Frame
from compas.geometry import Transformation

p=[3103.33,1481.11,366.83]
wobj_true1 = Frame.from_quaternion([0.999976,-0.00604606,-0.00149283,-0.0029774],p)

p = [3107.65,1478.91,367.994]
wobj_true2 = Frame.from_quaternion([0.99999,-0.00305874,-0.00165978,-0.0029736], p)

T = Transformation.from_frame_to_frame(wobj_true1,wobj_true2)

print wobj_true2.transformed(T.inverse())
print T
# ---------- end python_10 ----------
data_12 = Data(data)
data_13 = Data(config_2.config)

# ----
# If axis is included then allow the robot to move along track
rob_num = Number(list_4)
list_5 = ValueList({"Robot 1 - No Track, No Gripper": "robot1_notrack", "Robot 1 - No Track, Gripper": "robot1_notrack_gripper", "Robot 1 - Track, No Gripper": "robot1_track", "Robot 1 - Track, Gripper": "robot1_track_gripper"}, selected="Robot 1 - No Track, Gripper")
list_6 = ValueList({"Robot 2 - No Track, No Gripper": "robot2_notrack", "Robot 2 - No Track, Gripper": "robot2_notrack_gripper", "Robot 2 - Track, No Gripper": "robot2_track", "Robot 2 - Track, Gripper": "robot2_track_gripper"}, selected="Robot 2 - No Track, Gripper")
list_7 = ValueList({"Robot 3 - No Gripper": "robot3", "Robot 3 - Gripper": "robot3_gripper"}, selected="Robot 3 - No Gripper")
list_8 = ValueList({"platform": "ecl_platform", "wobj0", "acadia": "rob1_acadia_EBIT_01", "zerowaste": "ecl_rob1_zerowaste", "zerowaste_TEST": "ecl_rob1_zerowaste_test"}, selected="zerowaste")
list_9 = ValueList({"platform": "ecl_platform", "wobj0", "acadia": "rob2_acadia_EBIT_01", "zerowaste": "ecl_rob2_zerowaste"}, selected="zerowaste")
list_10 = ValueList({"world": "wobj0", "zerowaste": "ecl_rob3_zerowaste"}, selected="zerowaste")
data_14 = Data(list_5)
data_15 = Data(list_6)
panel_11 = Panel(rob_num)
panel_12 = Panel(rob_num)
filter = StreamFilter(Gate=panel_12, Stream1=list_8, Stream2=list_9, Stream3=list_10)
data_16 = Data(filter)

data_17 = Data(list_7)
panel_13 = Panel(rob_num)
filter_2 = StreamFilter(Gate=panel_13, Stream1=list_2, Stream2=list, Stream3=list_3)

filter_3 = StreamFilter(Gate=panel_11, Stream1=data_14, Stream2=data_15, Stream3=data_17)
data_18 = Data(filter_3)

r2_tcp_frames = Panel("""x1: [Frame(Point(2.766932, 1.480845, 0.366978), Vector(1.000, 0.024, -0.017), Vector(0.030, -0.855, 0.518))]
x2: [Frame(Point(3.108758, 1.478910, 0.367960), Vector(1.000, 0.024, -0.017), Vector(0.030, -0.855, 0.518))]
y1: [Frame(Point(3.108797, 1.667304, 0.366823), Vector(1.000, 0.024, -0.017), Vector(0.030, -0.855, 0.518))]""")
r3_tcp_frames = Panel("""x1: [Frame(Point(2.117427, 0.237057, 0.695275), Vector(-0.831, 0.545, 0.109), Vector(0.377, 0.697, -0.610))]
x2: [Frame(Point(1.775055, 0.240101, 0.695195), Vector(-0.831, 0.545, 0.109), Vector(0.377, 0.697, -0.610))]
y1: [Frame(Point(1.774582, 0.051813, 0.691629), Vector(-0.831, 0.546, 0.109), Vector(0.377, 0.697, -0.610))]""")
r1_tcp_frames = Panel("""x1: [Frame(Point(2.762768, 1.483214, 0.365833), Vector(-0.797, -0.574, -0.189), Vector(-0.506, 0.805, -0.311))]
x2: [Frame(Point(3.104401, 1.481151, 0.366987), Vector(-0.797, -0.574, -0.189), Vector(-0.506, 0.805, -0.311))]
y1: [Frame(Point(3.104434, 1.669760, 0.364630), Vector(-0.797, -0.574, -0.189), Vector(-0.506, 0.805, -0.311))]""")
python_11 = GhPythonScript()  # -> frames_wobj
# ---------- python_11: Python ----------
from compas.geometry import Frame
from compas.geometry import Point
from compas.geometry import Vector

#R1 calibration resulting frames
frames_wobj = {
'x1':Frame(Point(2.762768, 1.483214, 0.365833), Vector(-0.797, -0.574, -0.189), Vector(-0.506, 0.805, -0.311)),
'x2':Frame(Point(3.104401, 1.481151, 0.366987), Vector(-0.797, -0.574, -0.189), Vector(-0.506, 0.805, -0.311)),
'y1':Frame(Point(3.104434, 1.669760, 0.364630), Vector(-0.797, -0.574, -0.189), Vector(-0.506, 0.805, -0.311))
}

frames_wobj = [frames_wobj]
# ---------- end python_11 ----------
python_12 = GhPythonScript()  # -> frames_wobj
# ---------- python_12: Python ----------
from compas.geometry import Frame
from compas.geometry import Point
from compas.geometry import Vector

#R1 calibration resulting frames
frames_wobj = {
'x1':Frame(Point(2.766932, 1.480845, 0.366978), Vector(1.000, 0.024, -0.017), Vector(0.030, -0.855, 0.518)),
'x2':Frame(Point(3.108758, 1.478910, 0.367960), Vector(1.000, 0.024, -0.017), Vector(0.030, -0.855, 0.518)),
'y1':Frame(Point(3.108797, 1.667304, 0.366823), Vector(1.000, 0.024, -0.017), Vector(0.030, -0.855, 0.518))
}

frames_wobj = [frames_wobj]
# ---------- end python_12 ----------
python_13 = GhPythonScript()  # -> frames_wobj
# ---------- python_13: Python ----------
from compas.geometry import Frame
from compas.geometry import Point
from compas.geometry import Vector

#R1 calibration resulting frames
frames_wobj = {
'x1': Frame(Point(2.117427, 0.237057, 0.695275), Vector(-0.831, 0.545, 0.109), Vector(0.377, 0.697, -0.610)),
'x2': Frame(Point(1.775055, 0.240101, 0.695195), Vector(-0.831, 0.545, 0.109), Vector(0.377, 0.697, -0.610)),
'y1': Frame(Point(1.774582, 0.051813, 0.691629), Vector(-0.831, 0.546, 0.109), Vector(0.377, 0.697, -0.610))
}

frames_wobj = [frames_wobj]
# ---------- end python_13 ----------
panel_14 = Panel(rob_num)
filter_4 = StreamFilter(Gate=panel_14, Stream1=python_11, Stream2=python_12, Stream3=python_13)

data_19 = Data(filter_2)

panel_15 = Panel("C:\Users\Edvard\Documents\GitHub\zerowaste_robot\configs\presets")
panel_16 = Panel("/Users/edvard/Documents/github/zerowaste_robot/configs/presets")
list_11 = ValueList({"x1", "x2", "y1"}, selected="x1")
python_14 = GhPythonScript(robot=data_2, path=panel_16, point=list_11, read_data=Toggle(True))  # -> config, config_scaled
# ---------- python_14: Python ----------
import os
import math
from compas_fab.utilities import read_data_from_json
from compas_fab.robots import Configuration


config = robot.zero_configuration()

if read_data:
    
    for rob_num in range(1,4):
        data = read_data_from_json(os.path.join(path, 'R{}/wobj_{}.json'.format(rob_num,point)))
        #data = read_data_from_json(os.path.join(path, 'R{}\wobj_{}.json'.format(rob_num,point)))
        
        c = Configuration.from_data(data)
        
        if rob_num in [1, 2]:  # only R1 and R2 have an external axis
            config["r{}_cart_joint".format(rob_num)] = c.get("r{}_cart_joint".format(rob_num))
    
        config["r{}_joint_1".format(rob_num)] = c.get("r{}_joint_1".format(rob_num))
        config["r{}_joint_2".format(rob_num)] = c.get("r{}_joint_2".format(rob_num))
        config["r{}_joint_3".format(rob_num)] = c.get("r{}_joint_3".format(rob_num))
        config["r{}_joint_4".format(rob_num)] = c.get("r{}_joint_4".format(rob_num))
        config["r{}_joint_5".format(rob_num)] = c.get("r{}_joint_5".format(rob_num))
        config["r{}_joint_6".format(rob_num)] = c.get("r{}_joint_6".format(rob_num))

print(config)

config_scaled = robot.zero_configuration()

for i in range(6):
    config_scaled['r1_joint_{}'.format(i + 1)] = math.radians(config['r1_joint_{}'.format(i + 1)])
    config_scaled['r2_joint_{}'.format(i + 1)] = math.radians(config['r2_joint_{}'.format(i + 1)])
    config_scaled['r3_joint_{}'.format(i + 1)] = math.radians(config['r3_joint_{}'.format(i + 1)])

#mm --> m
config_scaled['r1_cart_joint'] = config['r1_cart_joint'.format(i + 1)]/1000
config_scaled['r2_cart_joint'] = config['r2_cart_joint'.format(i + 1)]/1000

print(config_scaled)
# ---------- end python_14 ----------
gripper_frames = GhPythonScript(robot=data_2, group=data_18, config=python_14.config_scaled)  # -> out, frame_t0cf
# ---------- gripper_frames: Python ----------
print repr(robot.forward_kinematics(config, group=group))

frame_t0cf = robot.forward_kinematics(config, group=group)
# ---------- end gripper_frames ----------

# ----
# move/rotate plane around on rhino canvas
pt_9 = Point(<point referenced from the Rhino model>)
crv = Curve(<curve referenced from the Rhino model>)
crv_2 = Curve(<curve referenced from the Rhino model>)
crv_3 = Curve(<curve referenced from the Rhino model>)
crv_4 = Curve(<curve referenced from the Rhino model>)
crv_5 = Curve(<curve referenced from the Rhino model>)
crv_6 = Curve(<curve referenced from the Rhino model>)
pt_10 = Point(<point referenced from the Rhino model>)
pt_11 = Point(<point referenced from the Rhino model>)
pl_3 = ConstructPlane(Origin=pt_9, XAxis=crv, YAxis=crv_6)
pl_4 = ConstructPlane(Origin=pt_10, XAxis=crv_2, YAxis=crv_3)
pl_5 = ConstructPlane(Origin=pt_11, XAxis=crv_4, YAxis=crv_5)
panel_17 = Panel(rob_num)
filter_5 = StreamFilter(Gate=panel_17, Stream1=pl_3, Stream2=pl_4, Stream3=pl_5)

# ----
# FORWARD KINEMATICS
config_3 = GhPythonScript(robot=data_2, r1=data_3, r2=data_4, r3=data_5)  # -> config; inputs r1: list, r2: list, r3: list
# ---------- config_3: Python ----------
import math

config = robot.zero_configuration()

for i in range(6):
    config['r1_joint_{}'.format(i + 1)] = math.radians(r1[i])
    config['r2_joint_{}'.format(i + 1)] = math.radians(r2[i])
    config['r3_joint_{}'.format(i + 1)] = math.radians(r3[i])

config['r1_cart_joint'] = r1[6]
config['r2_cart_joint'] = r2[6]

print config
# ---------- end config_3 ----------
gripper_frames_2 = GhPythonScript(robot=data_2, group=data_18, config=config_3)  # -> out
# ---------- gripper_frames_2: Python ----------
print repr(robot.forward_kinematics(config, group=group))
# ---------- end gripper_frames_2 ----------
panel_18 = Panel(gripper_frames_2)

pln_8 = Plane(filter_5)

# ----
# INVERSE KINEMATICS
use_fk_as_start = BooleanToggle(True)
data_20 = Data(config_3)
filter_6 = StreamFilter(Gate=use_fk_as_start, Stream1=data_20)
pln_9 = Plane(pln_8)
data_21 = Data(filter_6)
ik = InverseKinematics(robot=data_2, plane=pln_9, start_configuration=data_21, group=data_18)  # -> configuration
#   port plane: The plane or frame to calculate the inverse kinematic for.
#   port start_configuration: If passed, calculates the inverse such that the joint positions differ the least from the start_configuration. Defaults to the zero configuration.
#   port group: The planning group used for calculation. Defaults to the robot's main planning group.
#   port configuration: The planning group's configuration.
# ---------- ik: Python ----------
"""
Calculate the robot's inverse kinematic for a given plane.

COMPAS FAB v0.19.1
"""
from ghpythonlib.componentbase import executingcomponent as component

from compas_fab.ghpython.components import coerce_frame


class InverseKinematics(component):
    def RunScript(self, robot, plane, start_configuration, group):
        configuration = None
        if robot and robot.client and robot.client.is_connected and plane:
            frame = coerce_frame(plane)
            configuration = robot.inverse_kinematics(frame, start_configuration, group)
        if start_configuration:
            return start_configuration.merged(configuration)
        else:
            return configuration
# ---------- end ik ----------

python_15 = GhPythonScript()  # -> frame_tool
# ---------- python_15: Python ----------
from compas.geometry import Frame

#calibration tip tcp measured in (at 0)
frame_tool = Frame([0.000473456,0.000169985,0.163856], [1, 0, 0], [0, 1, 0])
# ---------- end python_15 ----------
python_16 = GhPythonScript()  # -> frame_tool
# ---------- python_16: Python ----------
from compas.geometry import Frame

#calibration tip tcp measured in (at 0)
frame_tool = Frame([0.000583723,0.0000236933,0.0779321], [1, 0, 0], [0, 1, 0])
# ---------- end python_16 ----------
python_17 = GhPythonScript()  # -> frame_tool
# ---------- python_17: Python ----------
from compas.geometry import Frame

#calibration tip tcp measured in (at 0)
frame_tool = Frame([-0.000441033,-0.0000930574,0.164273], [1, 0, 0], [0, 1, 0])
# ---------- end python_17 ----------
panel_19 = Panel(rob_num)
filter_7 = StreamFilter(Gate=panel_19, Stream1=python_17, Stream2=python_15, Stream3=python_16)

# ----
# tool TCF based on:
# actual values from controller
python_18 = GhPythonScript(point=list_11, frames_wobj=filter_4)  # -> out, tcf_draw, frame_tcf; inputs frames_wobj: list
# ---------- python_18: Python ----------
from compas_ghpython.artists import FrameArtist

frame_tcf = frames_wobj[0][point]

artist = FrameArtist(frame_tcf)
tcf_draw = artist.draw()
# ---------- end python_18 ----------
pln_10 = Plane(python_18.tcf_draw)

# ----
# tool TCF based on:
# FK using the URDF as defined
python_19 = GhPythonScript(frame_t0cf=gripper_frames.frame_t0cf, frame_tool=filter_7)  # -> out, tool, tc0f_draw, tcf_draw, frame_tcf; inputs frame_t0cf: list
# ---------- python_19: Python ----------
from compas.datastructures import Mesh
from compas.geometry import Frame
from compas_ghpython.artists import FrameArtist

import compas_fab
from compas_fab.robots import Tool

#mesh = Mesh.from_stl(compas_fab.get('planning_scene/cone.stl'))
mesh = Mesh.from_stl('/Users/edvard/Documents/github/ECL_robotic_cell/setup/catkin/abb_irb4600_40_255/meshes/collision/gripper.stl')
tool = Tool(mesh, frame_tool)

frame_tcf = tool.from_t0cf_to_tcf(frame_t0cf)
print frame_t0cf[0]
print frame_tcf[0]

artist1 = FrameArtist(frame_t0cf[0])
artist2 = FrameArtist(frame_tcf[0])

t0cf_draw = artist1.draw()
tcf_draw = artist2.draw()

frame_tcf = frame_tcf[0]
# ---------- end python_19 ----------
pln_11 = Plane(python_19.tc0f_draw)
pln_12 = Plane(python_19.tcf_draw)

list_12 = ValueList({"Forward Kinematics": 0, "Inverse Kinematics": 1, "Preset Start Planning Config": 2, "Preset Return Config": 3, "Preset WOBJ Points": 4}, selected="Inverse Kinematics")
filter_8 = StreamFilter(
    Gate=list_12,
    Stream0=config_3,
    Stream1=ik,
    Stream2=config.config_scaled,
    Stream3=config_2.config_scaled,
    Stream4=python_14.config_scaled)

panel_20 = Panel(python_19.out)
python_20 = GhPythonScript(R2=python_12, R3=python_19.frame_tcf, wobj_point=list_11)  # -> out, point_diff; inputs R2: list
# ---------- python_20: Python ----------
R2 = R2[0]

point_diff = R3.point - R2[wobj_point].point

print 1000*point_diff.x, 1000*point_diff.y, 1000*point_diff.z
# ---------- end python_20 ----------
python_21 = GhPythonScript(tcf_urdf=python_19.frame_tcf, tcf_actual=python_18.frame_tcf)  # -> out, point_diff
# ---------- python_21: Python ----------
from compas.geometry import Transformation

diff = Transformation.from_frame_to_frame(tcf_urdf,tcf_actual)

point_diff = tcf_urdf.point - tcf_actual.point

#print diff
print 1000*point_diff.x, 1000*point_diff.y, 1000*point_diff.z
# ---------- end python_21 ----------
panel_21 = Panel(pln_12)
panel_22 = Panel(pln_10)
robot_visualize = RobotVisualize(
    robot=data_2,
    group=data_18,
    configuration=filter_8,
    show_visual=Toggle(True),
    show_collision=Toggle(False),
    show_frames=Toggle(False),
    show_base_frame=Toggle(False),
    show_end_effector_frame=Toggle(False))  # -> visual, collision, attached_meshes, frames, base_frame, ee_frame; inputs attached_collision_meshes: list, show_visual: Boolean, show_collision: Boolean, show_frames: Boolean, show_base_frame: Boolean, show_end_effector_frame: Boolean, show_acm: Boolean
#   port group: The planning group used for end-effector and base visualization.
#   port configuration: The robot's full configuration.
#   port attached_collision_meshes: A list of attached collision meshes.
#   port show_visual: Whether or not to show the robot's visual meshes.
#   port show_collision: Whether or not to show the robot's collision meshes.
#   port show_frames: Whether or not to show the robot's joint frames.
#   port show_base_frame: Whether or not to show the robot's base frame.
#   port show_end_effector_frame: Whether or not to show the robot's end-effector frame.
#   port show_acm: Whether or not to show the attached collision meshes (if any).
#   port visual: The robot's visual Rhino meshes (if any).
#   port collision: The robot's collision Rhino meshes (if any).
#   port attached_meshes: The attached collision Rhino meshes (if any).
#   port frames: The robot's joint frames as Rhino planes (if any).
#   port base_frame: The robot's base frame as a Rhino plane (if any).
#   port ee_frame: The robot's end-effector frame as a Rhino plane (if any).
# ---------- robot_visualize: Python ----------
"""
Visualizes the robot.

COMPAS FAB v0.19.1
"""
from compas.geometry import Frame
from compas.geometry import Transformation
from compas_ghpython.artists import FrameArtist
from compas_ghpython.artists import MeshArtist
from ghpythonlib.componentbase import executingcomponent as component


class RobotVisualize(component):
    def RunScript(self, robot, group, configuration, attached_collision_meshes, show_visual, show_collision,
                  show_frames, show_base_frame, show_end_effector_frame, show_acm):

        visual = None
        collision = None
        attached_meshes = None
        frames = None
        base_frame = None
        ee_frame = None

        if robot:
            show_visual = True if show_visual is None else show_visual
            configuration = configuration or robot.zero_configuration()

            robot.update(configuration, visual=show_visual, collision=show_collision)
            compas_frames = robot.transformed_frames(configuration, group)

            if show_visual:
                visual = robot.artist.draw_visual()

            if show_collision:
                collision = robot.artist.draw_collision()

            if show_base_frame:
                base_compas_frame = compas_frames[0]
                artist = FrameArtist(base_compas_frame)
                base_frame = artist.draw()

            if show_end_effector_frame:
                ee_compas_frame = robot.forward_kinematics(configuration, group, options=dict(solver='model'))
                artist = FrameArtist(ee_compas_frame)
                ee_frame = artist.draw()

            if show_frames:
                frames = []
                for compas_frame in compas_frames[1:]:
                    artist = FrameArtist(compas_frame)
                    frame = artist.draw()
                    frames.append(frame)

            if show_acm:
                attached_meshes = []
                for acm in attached_collision_meshes:
                    frame = robot.forward_kinematics(configuration, options=dict(solver='model', link_name=acm.link_name))
                    T = Transformation.from_frame_to_frame(Frame.worldXY(), frame)
                    mesh = acm.collision_mesh.mesh.transformed(T)
                    attached_meshes.append(MeshArtist(mesh).draw())

        return (visual, collision, attached_meshes, frames, base_frame, ee_frame)
# ---------- end robot_visualize ----------
rec = DataRecorder(python_21.out, DataLimit=-10, RecordData=False)
rec_2 = DataRecorder(python_20.out, DataLimit=-10, RecordData=False)
pln_13 = Plane(robot_visualize.frames)
pln_14 = Plane(robot_visualize.base_frame)
pln_15 = Plane(robot_visualize.ee_frame)
item = ListItem(List=pln_13, Index=Slider(27, range=0..37), Wrap=True)
pln_16 = Plane(item)
pln_17 = Plane(pln_10)
pln_18 = Plane(pln_8)
python_22 = GhPythonScript(p_send=pln_18)  # -> f_send; inputs p_send: list
# ---------- python_22: Python ----------
from compas.geometry import Frame
from compas.geometry import Point
from compas.geometry import Vector
from compas.geometry import Transformation
from compas_ghpython import draw_frame
from compas_rhino.geometry import RhinoPlane
import copy

f_send = []
for p in p_send:
    f = RhinoPlane.from_geometry(p).to_compas()
    f_new = copy.deepcopy(f)
    f_new.point = f.point*1000
    
    f_send.append(f_new)
    

#p=[3103.33,1481.11,366.83]
#wobj_true1 = Frame.from_quaternion([0.999976,-0.00604606,-0.00149283,-0.0029774],p)
#
#p = [3107.65,1478.91,367.994]
#wobj_true2 = Frame.from_quaternion([0.99999,-0.00305874,-0.00165978,-0.0029736], p)
#
#
#tt = Transformation.from_frame_to_frame(wobj_true1,wobj_true2)
#f_send = wobj_true2.transformed(tt.inverse())
#
#f_send = wobj_true2

print f_send
# ---------- end python_22 ----------
python_23 = GhPythonScript(f_send=python_22, T=python_10.T)  # -> f_send_wobj, wobj_true; inputs f_send: list
# ---------- python_23: Python ----------
from compas.geometry import Frame
from compas_ghpython import draw_frame
from compas_rhino.geometry import RhinoPlane
import copy


p=[3103.33,1481.11,366.83]
wobj_true = Frame.from_quaternion([0.999976,-0.00604606,-0.00149283,-0.0029774],p)

f_send_wobj = []
for f in f_send:
    f_new = copy.deepcopy(f)
#    f_new = f_new.transformed(T.inverse())
    f_send_wobj.append(wobj_true.to_local_coordinates(f_new))
    
print f_send_wobj
# ---------- end python_23 ----------
python_24 = GhPythonScript(f_send=python_22)  # -> f_send_wobj, wobj_true; inputs f_send: list
# ---------- python_24: Python ----------
from compas.geometry import Frame
from compas_ghpython import draw_frame
from compas_rhino.geometry import RhinoPlane
import copy


p = [3107.65,1478.91,367.994]
wobj_true = Frame.from_quaternion([0.99999,-0.00305874,-0.00165978,-0.0029736], p)

f_send_wobj = []
for f in f_send:
    f_new = copy.deepcopy(f)
    f_send_wobj.append(wobj_true.to_local_coordinates(f_new))
    
print f_send_wobj
# ---------- end python_24 ----------
# SEND ROBOT COMMANDS
panel_23 = Panel(data_16)
panel_24 = Panel(data_19)
panel_25 = Panel(rob_num)
python_25 = GhPythonScript(
    ros=data_12,
    rob_num=panel_25,
    wobj=panel_23,
    tool=panel_24,
    return_config=data_13,
    send_return=Button(),
    r1_pick_path=python_23.f_send_wobj,
    r2_pick_path=python_24.f_send_wobj,
    send_pick=Button())  # -> out, current_joints; inputs rob_num: Int32, r1_pick_path: list, r2_pick_path: list, r1_place_startpath: list, r2_place_startpath: list, r1_place_endpath: list, r2_place_endpath: list
# ---------- python_25: Python ----------
import compas_rrc as rrc
from compas.geometry import Frame
from compas.geometry import Plane

from compas_rhino.geometry import RhinoPlane

# Create ABB Client (rob2 = right, rob1 = left)
if rob_num == 1:
    abb = rrc.AbbClient(ros, '/rob1')
#    abb.send(rrc.SetTool('ecl_pneumatic_gripper'))
    DO = 'do_1'
    pick_path = r1_pick_path
#    path_place_s = r1_place_startpath
#    path_place_e = r1_place_endpath
    #pick_track = 100
    
    print('Connected.')
elif rob_num == 2:
    abb = rrc.AbbClient(ros, '/rob2')
#    abb.send(rrc.SetTool('ecl_pneumatic_gripper'))
    DO = 'do_2'
    pick_path = r2_pick_path
#    path_place_s = r2_place_startpath
#    path_place_e = r2_place_endpath
    #pick_track = 3888.11
    
    print('Connected.')

# Define speeds
speed = 100

# set wobj
abb.send(rrc.SetWorkObject(wobj))
abb.send(rrc.SetTool(tool))

if get_info:
    current_joints = abb.send_and_wait(rrc.GetJoints(),  timeout = 3)
    print current_joints
    

if send_return:
    
    if rob_num == 1:
        axis = rrc.ExternalAxes(return_config['r1_cart_joint'])
        joints = rrc.RobotJoints(
            return_config['r1_joint_1'],
            return_config['r1_joint_2'],
            return_config['r1_joint_3'],
            return_config['r1_joint_4'],
            return_config['r1_joint_5'],
            return_config['r1_joint_6'],
        )
    elif rob_num == 2:
        axis = rrc.ExternalAxes(return_config['r2_cart_joint'])
        joints = rrc.RobotJoints(
            return_config['r2_joint_1'],
            return_config['r2_joint_2'],
            return_config['r2_joint_3'],
            return_config['r2_joint_4'],
            return_config['r2_joint_5'],
            return_config['r2_joint_6'],
        )
        
    done = abb.send(rrc.MoveToJoints(joints, axis, speed, rrc.Zone.FINE))
    print('Finished')


#if send_pick_OLD:
#    #open gripper
#    done = abb.send_and_wait(rrc.SetDigital(DO,0), timeout = 10)
#    
#    done = abb.send_and_wait(rrc.MoveToFrame(pick_path[0], speed, rrc.Zone.FINE), timeout = 30)
#    future = abb.send(rrc.Stop(feedback_level=rrc.FeedbackLevel.DONE))
#    
##    done = abb.send_and_wait(rrc.MoveToFrame(pick_path[1], speed, rrc.Zone.FINE), timeout = 30)
#    future = abb.send(rrc.Stop(feedback_level=rrc.FeedbackLevel.DONE))
#        
##    #close gripper
#    done = abb.send_and_wait(rrc.SetDigital(DO,1), timeout = 10)
#    
#    #back to start frame
#    done = abb.send_and_wait(rrc.MoveToFrame(pick_path[0], speed, rrc.Zone.FINE), timeout = 10)
#    future = abb.send(rrc.Stop(feedback_level=rrc.FeedbackLevel.DONE))
#    
##    #Final hard-coded config, path planning starts from here
#    if rob_num == 1:
#        axis = rrc.ExternalAxes(pick_config['r1_cart_joint'])
#        joints = rrc.RobotJoints(
#            pick_config['r1_joint_1'],
#            pick_config['r1_joint_2'],
#            pick_config['r1_joint_3'],
#            pick_config['r1_joint_4'],
#            pick_config['r1_joint_5'],
#            pick_config['r1_joint_6'],
#        )
#    elif rob_num == 2:
#        axis = rrc.ExternalAxes(pick_config['r2_cart_joint'])
#        joints = rrc.RobotJoints(
#            pick_config['r2_joint_1'],
#            pick_config['r2_joint_2'],
#            pick_config['r2_joint_3'],
#            pick_config['r2_joint_4'],
#            pick_config['r2_joint_5'],
#            pick_config['r2_joint_6'],
#        )
#        
#    done = abb.send(rrc.MoveToJoints(joints, axis, speed, rrc.Zone.FINE))
#    print('Finished')
    
    
if send_pick:
    
    for f in pick_path:
        done = abb.send_and_wait(rrc.MoveToFrame(f, speed, rrc.Zone.FINE), timeout = 30)
        future = abb.send(rrc.Stop(feedback_level=rrc.FeedbackLevel.DONE))
    
    
if send_place_start:
    # execute planned path
    # formatted as RobotJoints and ExternalAxes object 
    
    last_axis, last_joints = path_place_s.pop(-1)
    
    for axis,joints in path_place_s:
        print axis, joints
        done = abb.send(rrc.MoveToJoints(joints, axis, speed, rrc.Zone.Z10))
    
    done = abb.send(rrc.MoveToJoints(last_joints, last_axis, speed, rrc.Zone.FINE))
    
    print('Finished')

if send_place_end:
    
    # execute planned path
    # formatted as RobotJoints and ExternalAxes object 
    
    last_axis, last_joints = path_place_e.pop(-1)
    
    for axis,joints in path_place_e:
        print axis, joints
        done = abb.send(rrc.MoveToJoints(joints, axis, speed/3, rrc.Zone.Z10))
        
    done = abb.send(rrc.MoveToJoints(last_joints, last_axis, speed/3, rrc.Zone.FINE))

    print('Finished')
# ---------- end python_25 ----------

# ----
# ROBOT1
panel_26 = Panel("3246.00")
pt_12 = ConstructPoint(XCoordinate=panel_26, YCoordinate="1838.30", ZCoordinate="729.60")
Z_2 = UnitZ(Factor="450.00")
division_3 = Division(A=pt_12, B=1000)
division_4 = Division(A=Z_2, B=1000)
pl_6 = ConstructPlane(Origin=division_3, XAxis=Vector(-1, 0, 0), YAxis=Vector(0, 1, 0))
move_3 = Move(Geometry=pl_6, Motion=division_4)  # -> Geometry, Transform
pln_19 = Plane(move_3.Geometry)
pln_20 = Plane(pl_6)

# ----
# MEMBER PICKUP PLANES
pl_7 = ConstructPlane(Origin=pt_12, XAxis=Vector(-1, 0, 0), YAxis=Vector(0, 1, 0))

move_4 = Move(Geometry=pl_7, Motion=Z_2)  # -> Geometry, Transform
pln_21 = Plane(move_4.Geometry)
pln_22 = Plane(pl_7)

# ---- group: send pickup planes
python_26 = GhPythonScript()  # -> t_a
# ---------- python_26: Python ----------
from compas.geometry import Frame
from compas.geometry import Point
from compas_ghpython import draw_frame
from compas.geometry import Transformation

from compas_rhino.geometry import RhinoPlane

wobj_A = Frame.from_quaternion([0.999964,0.00426176,-0.00158504,-0.00717332])
wobj_A.point = [-681.039,1564.71,817.284]

f_a = RhinoPlane.from_geometry(wobj_A).to_compas() 
print(f_a)

t_a = Transformation.from_frame(f_a)
print t_a
# ---------- end python_26 ----------
merge_2 = Merge(Data1=pln_21, Data2=pln_22)
merge_3 = Merge(Data1=pln_5, Data2=pln_6)
python_27 = GhPythonScript(p_send=merge_2, t_a=python_26)  # -> f_send; inputs p_send: list
# ---------- python_27: Python ----------
from compas.geometry import Frame
from compas_ghpython import draw_frame
from compas_rhino.geometry import RhinoPlane
#
f_send = []
for p in p_send:
    f = RhinoPlane.from_geometry(p).to_compas()
    f_send.append(f)
#    f_trans = f.transformed(t_a.inverse())
#    f_send.append(f_trans)
    
    
print f_send
# ---------- end python_27 ----------
python_28 = GhPythonScript(p_send=merge_3, t_a=python_26)  # -> f_send; inputs p_send: list
# ---------- python_28: Python ----------
from compas.geometry import Frame
from compas_ghpython import draw_frame
from compas_rhino.geometry import RhinoPlane
#
f_send = []
for p in p_send:
    f = RhinoPlane.from_geometry(p).to_compas()
#    f_send.append(f)
    f_trans = f.transformed(t_a.inverse())
    f_send.append(f_trans)
    
print f_send
# ---------- end python_28 ----------

# ----
merge_4 = Merge(Data1=pln_19, Data2=pln_20)
